# Grasshopper definition Cuckoo-1.0.1.gh (Grasshopper 1.0.8)

point = Point(Point(5185.405263, 1512.070639, -2645.860525))
brep = Brep(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)

geometry = Geometry([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])
mesh_brep = MeshBrep(
    Brep=brep,
    Settings={GridMaxCount=0, GridMinCount=16, JaggedSeams=False, MaxEdgeLength=0, MinEdgeLength=0.0001, MinTolerance=0, Refine=True, RefineAngle=0, RelativeTolerance=0.65, SimplePlanes=True, Tolerance=0})
c_script = CSharpScript(mesh=mesh_brep, originPt=point, rayLength=Slider(16, range=0..1000), rayCount=Slider(18, range=0..100))  # -> Rays, Hits, Energies, RT60; inputs mesh: Mesh, originPt: Point3d, rayLength: Double, rayCount: Int32
# ---------- c_script: C# ----------
using Rhino;
using Rhino.Geometry;
using System;
using System.Collections.Generic;

public class Script_Instance : GH_ScriptInstance
{
    private void RunScript(
		Mesh mesh,
		Point3d originPt,
		double rayLength,
		int rayCount,
		ref object Rays,
		ref object Hits,
		ref object Energies,
		ref object RT60)
    {
        if (mesh == null) return; 
        
        // Compute frequency-dependent RT60 
        List<double> rt60Values = ComputeSabineRT60_Frequency(mesh); 
        
        // Unit correction 
        double scale = RhinoMath.UnitScale( 
            RhinoDoc.ActiveDoc.ModelUnitSystem, 
            UnitSystem.Meters
        ); 
        double correctedRayLength = rayLength / scale; 
        
        // Ray tracing with acoustic energy 
        
        RayCasting3D raycaster = new RayCasting3D( mesh, originPt, correctedRayLength, rayCount ); 
        List<Line> rayLines; 
        List<Point3d> hitPoints; 
        List<double> rayEnergies; 
        raycaster.ComputeRays( out rayLines, out hitPoints, out rayEnergies ); 
        
        // Outputs 
        Rays = rayLines; 
        Hits = hitPoints; 
        Energies = rayEnergies; 
        RT60 = rt60Values;
    }

    // FREQUENCY-DEPENDENT SABINE RT60 ---
    private List<double> ComputeSabineRT60_Frequency(Mesh mesh) 
    {
        List<double> rt60List = new List<double>();
        if (mesh == null) 
            return rt60List;

        double scale = RhinoMath.UnitScale( 
            RhinoDoc.ActiveDoc.ModelUnitSystem, 
            UnitSystem.Meters 
        );

        var vmp = VolumeMassProperties.Compute(mesh);

        if (vmp == null || Math.Abs(vmp.Volume) < 0.001) 
            return rt60List;

        double volumeM3 = Math.Abs(vmp.Volume) * Math.Pow(scale, 3);

        var amp = AreaMassProperties.Compute(mesh);

        double areaM2 = (amp != null) ? amp.Area * Math.Pow(scale, 2) : 1.0;

        // Octave bands: // 63, 125, 250, 500, 1k, 2k, 4k, 8k Hz
        double[] alpha = { 0.002, 0.004, 0.01, 0.02, 0.05, 0.10, 0.20, 0.35 };

        // Compute RT60 per frequency band
        for (int i = 0; i < alpha.Length; i++) 
        { 
            double absorption = areaM2 * alpha[i]; 
            double rt60 = (0.161 * volumeM3) / Math.Max(absorption, 0.001); 
            rt60List.Add(rt60); 
        } 
        return rt60List; 
    }
    // RAY CASTING WITH ACOUSTIC ENERGY ---
    public class RayCasting3D 
    { 
        private Mesh _mesh; 
        private Point3d _origin; 
        private double _rayLength; 
        private int _rayCount; 
        private const int MAX_BOUNCES = 5;
        
        // Rays below this energy are no longer significant 
        private const double MIN_ENERGY = 0.01;
        public RayCasting3D( 
            Mesh mesh, 
            Point3d origin, 
            double rayLength, 
            int rayCount) 
        { 
            _mesh = mesh; 
            _origin = origin; 
            _rayLength = rayLength; 
            _rayCount = Math.Max(rayCount, 10); 
        }
        // COMPUTE ALL RAYS
        public void ComputeRays( 
            out List<Line> rays, 
            out List<Point3d> intersections, 
            out List<double> energies) 
        {
            rays = new List<Line>(); 
            intersections = new List<Point3d>(); 
            energies = new List<double>();
            for (int i = 0; i < _rayCount; i++) 
            { 
                // Fibonacci sphere sampling 
                double phi = Math.Acos( 1 - 2 * (i + 0.5) / _rayCount );
                double theta = Math.PI * (1 + Math.Sqrt(5)) * i;

                Vector3d dir = new Vector3d( 
                    Math.Sin(phi) * Math.Cos(theta), 
                    Math.Sin(phi) * Math.Sin(theta), 
                    Math.Cos(phi) 
                );

                dir.Unitize();

                // Initial acoustic 
                double initialEnergy = 1.0;
                TraceRay( 
                    _origin, 
                    dir, 
                    initialEnergy, 
                    rays, 
                    intersections, 
                    energies 
                );
            }
        }

        // TRACE INDIVIDUAL RAY
        private void TraceRay( 
            Point3d start, 
            Vector3d direction, 
            double energy, 
            List<Line> rays, 
            List<Point3d> hits, 
            List<double> energies) 
        {
            Point3d currentOrigin = start;
            Vector3d dir = direction;
            for ( int bounce = 0; bounce < MAX_BOUNCES; bounce++ )
            { 
                // Stop if acoustic energy becomes negligible 
                if (energy < MIN_ENERGY) 
                    break; 
                // Create ray 
                var ray = new Ray3d( currentOrigin, dir );
                
                // Find mesh intersection 
                double t = Rhino.Geometry.Intersect.Intersection.MeshRay( _mesh, ray );
                
                // No intersection 
                if (t < 0 || t > _rayLength) 
                    break;
                
                // Intersection point 
                Point3d hitPt = ray.PointAt(t);

                // Store ray segment 
                rays.Add( new Line( currentOrigin, hitPt ) );

                // Store intersection 
                hits.Add(hitPt); 
                
                // Store CURRENT energy 
                energies.Add(energy);

                // FIND SURFACE
                var mp = _mesh.ClosestMeshPoint( hitPt, 0.0 );
                if (mp == null) break;

                // SURFACE NORMAL
                Vector3d normal = _mesh.NormalAt(mp); 
                normal.Unitize();

                // MATERIAL ABSORPTION
                double alpha = GetAbsorptionCoefficient( mp.FaceIndex );

                // ENERGY ABSORPTION
                energy = energy * (1.0 - alpha);

                // REFLECTION
                dir = dir - 2 * Vector3d.Multiply( dir * normal, normal ); 
                dir.Unitize();

                // OFFSET RAY
                currentOrigin = hitPt + dir * 0.01;
            }
        }

        // MATERIAL ABSORPTION COEFFICIENT
        private double GetAbsorptionCoefficient( int faceIndex) {
            double alpha = 0.05; 
            return Math.Max( 
                0.0, 
                Math.Min(1.0, alpha) 
            );
        }
    }
}
# ---------- end c_script ----------
line = Line(c_script.Rays)
panel = Panel(c_script.RT60)
