# Grasshopper definition Cuckoo-1.1.1.gh (Grasshopper 1.0.8)

point = Point(Point(5185.405263, 1512.070639, -2645.860525))
brep = Brep(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)

geometry = Geometry([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])
c_script = CSharpScript(
    brep=brep,
    originPt=point,
    rayLength=Slider(16, range=0..1000),
    rayCount=Slider(18, range=0..100),
    maxBounces=Slider(5, range=0..10))  # -> Rays; inputs brep: Brep, originPt: Point3d, rayLength: Double, rayCount: Int32, maxBounces: Int32
# ---------- c_script: C# ----------
using Rhino;
using Rhino.Geometry;
using Rhino.Geometry.Intersect;
using System;
using System.Collections.Generic;

public class Script_Instance : GH_ScriptInstance
{
    private void RunScript(
		Brep brep,
		Point3d originPt,
		double rayLength,
		int rayCount,
		int maxBounces,
		ref object Rays)
    {
       if (brep == null)
            return;

        rayCount = Math.Max(rayCount, 1);
        maxBounces = Math.Max(maxBounces, 1);
        rayLength = Math.Max(rayLength, 0.001);

        List<Line> rays = new List<Line>();


        // Generate initial ray directions
        for (int i = 0; i < rayCount; i++)
        {
            // Fibonacci sphere distribution
            double phi =
                Math.Acos(
                    1.0 -
                    2.0 * (i + 0.5) / rayCount
                );

            double theta =
                Math.PI *
                (1.0 + Math.Sqrt(5.0)) *
                i;

            Vector3d direction =
                new Vector3d(
                    Math.Sin(phi) * Math.Cos(theta),
                    Math.Sin(phi) * Math.Sin(theta),
                    Math.Cos(phi)
                );

            direction.Unitize();

            // Trace ray
            TraceRay(
                brep,
                originPt,
                direction,
                rayLength,
                maxBounces,
                rays
            );
        }

        Rays = rays;
    }

    // TRACE ONE RAY ---
    private void TraceRay(
        Brep brep,
        Point3d start,
        Vector3d direction,
        double rayLength,
        int maxBounces,
        List<Line> rays)
    {
        Point3d currentOrigin = start;
        Vector3d currentDirection = direction;

        // Small offset to prevent self-intersection
        double offset = 0.001;


        for (int bounce = 0;
             bounce < maxBounces;
             bounce++)
        {
            // Create finite ray
            Point3d endPoint =
                currentOrigin +
                currentDirection * rayLength;

            LineCurve rayCurve =
                new LineCurve(
                    currentOrigin,
                    endPoint
                );

            // Brep intersection
            Curve[] overlapCurves;
            Point3d[] intersectionPoints;
            double[] curveParameters;

            bool success =
                Intersection.CurveBrep(
                    rayCurve,
                    brep,
                    RhinoDoc.ActiveDoc.ModelAbsoluteTolerance,
                    out overlapCurves,
                    out intersectionPoints,
                    out curveParameters
                );


            // No intersection
            if (!success ||
                intersectionPoints == null ||
                intersectionPoints.Length == 0)
            {
                break;
            }


            // Find nearest intersection
            double nearestDistance =
                double.MaxValue;

            Point3d nearestPoint =
                Point3d.Unset;


            foreach (Point3d point in intersectionPoints)
            {
                double distance =
                    currentOrigin.DistanceTo(point);

                // Ignore self-intersection
                if (distance <= offset)
                    continue;

                if (distance < nearestDistance)
                {
                    nearestDistance = distance;
                    nearestPoint = point;
                }
            }


            // No valid intersection
            if (!nearestPoint.IsValid)
                break;

            // Store ray segment
            rays.Add(
                new Line(
                    currentOrigin,
                    nearestPoint
                )
            );

            // Find the Brep face at the hit point
            BrepFace face =
                FindClosestFace(
                    brep,
                    nearestPoint
                );

            if (face == null)
                break;

            // Find UV coordinates
            double u;
            double v;

            if (!face.ClosestPoint(
                nearestPoint,
                out u,
                out v))
            {
                break;
            }

            // Surface normal
            Vector3d normal =
                face.NormalAt(u, v);

            normal.Unitize();

            // Reflection R = D - 2(D·N)N
            double dot =
                currentDirection * normal;

            Vector3d reflectedDirection =
                currentDirection -
                2.0 * dot * normal;

            reflectedDirection.Unitize();

            // Move slightly away from surface
            currentOrigin =
                nearestPoint +
                reflectedDirection * offset;

            currentDirection =
                reflectedDirection;
        }
    }

    // FIND CLOSEST BREP FACE---

    private BrepFace FindClosestFace(
        Brep brep,
        Point3d point)
    {
        double minimumDistance =
            double.MaxValue;

        BrepFace closestFace = null;


        foreach (BrepFace face in brep.Faces)
        {
            double u;
            double v;

            if (!face.ClosestPoint(
                point,
                out u,
                out v))
            {
                continue;
            }


            Point3d closestPoint =
                face.PointAt(u, v);

            double distance =
                point.DistanceTo(
                    closestPoint
                );


            if (distance < minimumDistance)
            {
                minimumDistance = distance;
                closestFace = face;
            }
        }


        return closestFace;
    }
}
# ---------- end c_script ----------
line = Line(c_script)
panel = Panel(line)
