# Grasshopper definition Cuckoo-1.2.0.gh (Grasshopper 1.0.8)

point = Point(Point(5185.405263, 1512.070639, -2645.860525))
brep = Brep(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)

geometry = Geometry([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])
c_script = CSharpScript(Brep=brep, Iterations=Slider(150, range=100..10000))  # -> Variants, Data; inputs Brep: Brep, Iterations: Int32
# ---------- c_script: C# ----------
using System;
using System.Collections.Generic;
using Rhino;
using Rhino.Geometry;

public class Script_Instance : GH_ScriptInstance
{
    private void RunScript(
		Brep Brep,
		int Iterations,
		ref object Variants,
		ref object Data)
    {
        List<Brep> outputGeometry = new List<Brep>();
        List<string> outputData = new List<string>();

        if (Brep == null)
            return;

        if (Iterations <= 0)
            return;

        // 1. GET ORIGINAL GEOMETRY DIMENSIONS
        BoundingBox bbox = Brep.GetBoundingBox(true);

        double L0 = bbox.Max.X - bbox.Min.X;
        double W0 = bbox.Max.Y - bbox.Min.Y;
        double H0 = bbox.Max.Z - bbox.Min.Z;

        if (L0 <= 0 || W0 <= 0 || H0 <= 0)
            return;

        // 2. ORIGINAL PROPORTIONS
        double originalLW = L0 / W0;
        double originalLH = L0 / H0;
        double originalWH = W0 / H0;

        double originalArea =
            2.0 * (L0 * W0 + L0 * H0 + W0 * H0);

        double originalVolume =
            L0 * W0 * H0;

        // 3. GA SETTINGS

        int populationSize = 50;

        // Maximum change from original dimensions
        double variation = 0.05;   // ±5%

        // Mutation probability
        double mutationRate = 0.20;

        // Mutation magnitude
        double mutationStrength = 0.02;

        // Random seed
        Random random = new Random(12345);

        // 4. INITIAL POPULATION
        List<Individual> population =
            new List<Individual>();

        for (int i = 0; i < populationSize; i++)
        {
            double l =
                L0 * (1.0 + RandomRange(random, -variation, variation));

            double w =
                W0 * (1.0 + RandomRange(random, -variation, variation));

            double h =
                H0 * (1.0 + RandomRange(random, -variation, variation));

            population.Add(
                new Individual(l, w, h)
            );
        }

        // 5. EVALUATE INITIAL POPULATION
        EvaluatePopulation(
            population,
            L0,
            W0,
            H0,
            originalLW,
            originalLH,
            originalWH
        );

        // 6. GENETIC ALGORITHM
        int generated = 0;

        while (generated < Iterations)
        {
            // Sort population by fitness
            population.Sort(
                delegate(Individual a, Individual b)
                {
                    return b.Fitness.CompareTo(a.Fitness);
                }
            );

            // Output best individual
            Individual best = population[0];

            Brep box = CreateBox(
                best.L,
                best.W,
                best.H,
                bbox.Min
            );

            outputGeometry.Add(box);

            // Calculate derived parameters
            double area =
                2.0 * (
                    best.L * best.W +
                    best.L * best.H +
                    best.W * best.H
                );

            double volume =
                best.L * best.W * best.H;

            double lw =
                best.L / best.W;

            double lh =
                best.L / best.H;

            double wh =
                best.W / best.H;


            // Store dataset information
            string row =
                generated.ToString() + "," +
                best.L.ToString("F6") + "," +
                best.W.ToString("F6") + "," +
                best.H.ToString("F6") + "," +
                area.ToString("F6") + "," +
                volume.ToString("F6") + "," +
                lw.ToString("F6") + "," +
                lh.ToString("F6") + "," +
                wh.ToString("F6") + "," +
                best.Fitness.ToString("F6");

            outputData.Add(row);

            generated++;


            // Stop if requested number has been reached
            if (generated >= Iterations)
                break;

            // Create new generation
            List<Individual> newPopulation =
                new List<Individual>();

            // Elitism : Keep best 2 individuals
            newPopulation.Add(
                population[0].Clone()
            );

            if (populationSize > 1)
            {
                newPopulation.Add(
                    population[1].Clone()
                );
            }


            // Fill remaining population
            while (newPopulation.Count < populationSize)
            {
                // Tournament selection
                Individual parent1 =
                    TournamentSelection(
                        population,
                        random
                    );

                Individual parent2 =
                    TournamentSelection(
                        population,
                        random
                    );


                // Crossover
                Individual child =
                    Crossover(
                        parent1,
                        parent2,
                        random
                    );


                // Mutation
                Mutate(
                    child,
                    L0,
                    W0,
                    H0,
                    mutationRate,
                    mutationStrength,
                    variation,
                    random
                );


                newPopulation.Add(child);
            }


            population = newPopulation;


            // Evaluate new generation
            EvaluatePopulation(
                population,
                L0,
                W0,
                H0,
                originalLW,
                originalLH,
                originalWH
            );
        }

        // OUTPUT
        Variants = outputGeometry;


        List<string> csv =
            new List<string>();

        csv.Add(
            "ID,Length,Width,Height,SurfaceArea,Volume,L_W,L_H,W_H,Fitness"
        );

        csv.AddRange(outputData);

        Data = csv;
    }

    

   // Individual ---
    class Individual
    {
        public double L;
        public double W;
        public double H;

        public double Fitness;

        public Individual(double l, double w, double h)
        {
            L = l;
            W = w;
            H = h;
        }

        public Individual Clone()
        {
            return new Individual(L, W, H);
        }
    }

   // FITNESS ---
    private void EvaluatePopulation(
        List<Individual> population,
        double L0,
        double W0,
        double H0,
        double originalLW,
        double originalLH,
        double originalWH)
    {
        foreach (Individual ind in population)
        {
            double currentLW =
                ind.L / ind.W;

            double currentLH =
                ind.L / ind.H;

            double currentWH =
                ind.W / ind.H;


            // Proportion differences
            double errorLW =
                Math.Abs(currentLW - originalLW)
                / originalLW;

            double errorLH =
                Math.Abs(currentLH - originalLH)
                / originalLH;

            double errorWH =
                Math.Abs(currentWH - originalWH)
                / originalWH;


            // Dimension difference
            double errorL =
                Math.Abs(ind.L - L0) / L0;

            double errorW =
                Math.Abs(ind.W - W0) / W0;

            double errorH =
                Math.Abs(ind.H - H0) / H0;


            // Total error - Higher weight on proportions
            double proportionError =
                (errorLW + errorLH + errorWH) / 3.0;

            double dimensionError =
                (errorL + errorW + errorH) / 3.0;


            double totalError =
                proportionError * 0.70 +
                dimensionError * 0.30;


            // Fitness: 
            // 1.0 = identical to original
            // Lower values = more different
            ind.Fitness =
                1.0 / (1.0 + totalError);
        }
    }

   // TOURNAMENT SELECTION ---
    private Individual TournamentSelection(
        List<Individual> population,
        Random random)
    {
        int tournamentSize = 3;

        Individual best = null;

        for (int i = 0; i < tournamentSize; i++)
        {
            int index =
                random.Next(population.Count);

            Individual candidate =
                population[index];

            if (best == null ||
                candidate.Fitness > best.Fitness)
            {
                best = candidate;
            }
        }

        return best;
    }

   // CROSSOVER ---
    private Individual Crossover(
        Individual a,
        Individual b,
        Random random)
    {
        double tL = random.NextDouble();
        double tW = random.NextDouble();
        double tH = random.NextDouble();

        double L =
            a.L * tL +
            b.L * (1.0 - tL);

        double W =
            a.W * tW +
            b.W * (1.0 - tW);

        double H =
            a.H * tH +
            b.H * (1.0 - tH);

        return new Individual(L, W, H);
    }

   // MUTATION ---
    private void Mutate(
        Individual ind,
        double L0,
        double W0,
        double H0,
        double mutationRate,
        double mutationStrength,
        double variation,
        Random random)
    {
        // Length
        if (random.NextDouble() < mutationRate)
        {
            ind.L *=
                1.0 +
                RandomRange(
                    random,
                    -mutationStrength,
                    mutationStrength
                );
        }


        // Width
        if (random.NextDouble() < mutationRate)
        {
            ind.W *=
                1.0 +
                RandomRange(
                    random,
                    -mutationStrength,
                    mutationStrength
                );
        }


        // Height
        if (random.NextDouble() < mutationRate)
        {
            ind.H *=
                1.0 +
                RandomRange(
                    random,
                    -mutationStrength,
                    mutationStrength
                );
        }

        // Keep geometry within allowed variation
        ind.L =
            Clamp(
                ind.L,
                L0 * (1.0 - variation),
                L0 * (1.0 + variation)
            );

        ind.W =
            Clamp(
                ind.W,
                W0 * (1.0 - variation),
                W0 * (1.0 + variation)
            );

        ind.H =
            Clamp(
                ind.H,
                H0 * (1.0 - variation),
                H0 * (1.0 + variation)
            );
    }

   // CREATE BOX ---
    private Brep CreateBox(
        double L,
        double W,
        double H,
        Point3d origin)
    {
        Point3d p0 = origin;
        Point3d p1 = origin + new Vector3d(L, 0, 0);
        Point3d p2 = origin + new Vector3d(L, W, 0);

        BoundingBox box =
            new BoundingBox(
                p0,
                p2 + new Vector3d(0, 0, H)
            );

        Brep boxBrep = Brep.CreateFromBox(box);

        return boxBrep;
    }

   // RANDOM RANGE ---
    private double RandomRange(
        Random random,
        double min,
        double max)
    {
        return min +
               random.NextDouble() *
               (max - min);
    }

   // CLAMP ---
    private double Clamp(
        double value,
        double min,
        double max)
    {
        return Math.Max(
            min,
            Math.Min(max, value)
        );
    }

}
# ---------- end c_script ----------
c_script_2 = CSharpScript(
    brep=brep,
    originPt=point,
    rayLength=Slider(16, range=0..1000),
    rayCount=Slider(18, range=0..100),
    maxBounces=Slider(5, range=0..10))  # -> Rays; inputs brep: Brep, originPt: Point3d, rayLength: Double, rayCount: Int32, maxBounces: Int32
# ---------- c_script_2: C# ----------
using Rhino;
using Rhino.Geometry;
using Rhino.Geometry.Intersect;
using System;
using System.Collections.Generic;

public class Script_Instance : GH_ScriptInstance
{
    private void RunScript(
		Brep brep,
		Point3d originPt,
		double rayLength,
		int rayCount,
		int maxBounces,
		ref object Rays)
    {
       if (brep == null)
            return;

        rayCount = Math.Max(rayCount, 1);
        maxBounces = Math.Max(maxBounces, 1);
        rayLength = Math.Max(rayLength, 0.001);

        List<Line> rays = new List<Line>();


        // Generate initial ray directions
        for (int i = 0; i < rayCount; i++)
        {
            // Fibonacci sphere distribution
            double phi =
                Math.Acos(
                    1.0 -
                    2.0 * (i + 0.5) / rayCount
                );

            double theta =
                Math.PI *
                (1.0 + Math.Sqrt(5.0)) *
                i;

            Vector3d direction =
                new Vector3d(
                    Math.Sin(phi) * Math.Cos(theta),
                    Math.Sin(phi) * Math.Sin(theta),
                    Math.Cos(phi)
                );

            direction.Unitize();

            // Trace ray
            TraceRay(
                brep,
                originPt,
                direction,
                rayLength,
                maxBounces,
                rays
            );
        }

        Rays = rays;
    }

    // TRACE ONE RAY ---
    private void TraceRay(
        Brep brep,
        Point3d start,
        Vector3d direction,
        double rayLength,
        int maxBounces,
        List<Line> rays)
    {
        Point3d currentOrigin = start;
        Vector3d currentDirection = direction;

        // Small offset to prevent self-intersection
        double offset = 0.001;


        for (int bounce = 0;
             bounce < maxBounces;
             bounce++)
        {
            // Create finite ray
            Point3d endPoint =
                currentOrigin +
                currentDirection * rayLength;

            LineCurve rayCurve =
                new LineCurve(
                    currentOrigin,
                    endPoint
                );

            // Brep intersection
            Curve[] overlapCurves;
            Point3d[] intersectionPoints;
            double[] curveParameters;

            bool success =
                Intersection.CurveBrep(
                    rayCurve,
                    brep,
                    RhinoDoc.ActiveDoc.ModelAbsoluteTolerance,
                    out overlapCurves,
                    out intersectionPoints,
                    out curveParameters
                );


            // No intersection
            if (!success ||
                intersectionPoints == null ||
                intersectionPoints.Length == 0)
            {
                break;
            }


            // Find nearest intersection
            double nearestDistance =
                double.MaxValue;

            Point3d nearestPoint =
                Point3d.Unset;


            foreach (Point3d point in intersectionPoints)
            {
                double distance =
                    currentOrigin.DistanceTo(point);

                // Ignore self-intersection
                if (distance <= offset)
                    continue;

                if (distance < nearestDistance)
                {
                    nearestDistance = distance;
                    nearestPoint = point;
                }
            }


            // No valid intersection
            if (!nearestPoint.IsValid)
                break;

            // Store ray segment
            rays.Add(
                new Line(
                    currentOrigin,
                    nearestPoint
                )
            );

            // Find the Brep face at the hit point
            BrepFace face =
                FindClosestFace(
                    brep,
                    nearestPoint
                );

            if (face == null)
                break;

            // Find UV coordinates
            double u;
            double v;

            if (!face.ClosestPoint(
                nearestPoint,
                out u,
                out v))
            {
                break;
            }

            // Surface normal
            Vector3d normal =
                face.NormalAt(u, v);

            normal.Unitize();

            // Reflection R = D - 2(D·N)N
            double dot =
                currentDirection * normal;

            Vector3d reflectedDirection =
                currentDirection -
                2.0 * dot * normal;

            reflectedDirection.Unitize();

            // Move slightly away from surface
            currentOrigin =
                nearestPoint +
                reflectedDirection * offset;

            currentDirection =
                reflectedDirection;
        }
    }

    // FIND CLOSEST BREP FACE---

    private BrepFace FindClosestFace(
        Brep brep,
        Point3d point)
    {
        double minimumDistance =
            double.MaxValue;

        BrepFace closestFace = null;


        foreach (BrepFace face in brep.Faces)
        {
            double u;
            double v;

            if (!face.ClosestPoint(
                point,
                out u,
                out v))
            {
                continue;
            }


            Point3d closestPoint =
                face.PointAt(u, v);

            double distance =
                point.DistanceTo(
                    closestPoint
                );


            if (distance < minimumDistance)
            {
                minimumDistance = distance;
                closestFace = face;
            }
        }


        return closestFace;
    }
}
# ---------- end c_script_2 ----------
panel = Panel(c_script.Variants)
line = Line(c_script_2)
panel_2 = Panel(line)
