# Grasshopper definition Cuckoo-1.2.2.gh (Grasshopper 1.0.8)

point = Point(Point(5185.405263, 1512.070639, -2645.860525))
brep = Brep(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)

geometry = Geometry([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])

# ---- group: Latin Hypercube Sampling
c_script = CSharpScript(
    Brep=brep,
    Iterations=Slider(100, range=0..100),
    ScaleVariation=Slider(0.05, range=0..0.1),
    DimensionVariation=Slider(0.02, range=0..0.1),
    RatioTolerance=Slider(0.01, range=0..0.01),
    Seed=Slider(12345, range=0..100000))  # -> Variants, Data; inputs Brep: Brep, Iterations: Int32, ScaleVariation: Double, DimensionVariation: Double, RatioTolerance: Double, Seed: Int32
# ---------- c_script: C# ----------
using System;
using System.Collections.Generic;
using Rhino;
using Rhino.Geometry;

public class Script_Instance : GH_ScriptInstance
{
    private void RunScript(
		Brep Brep,
		int Iterations,
		double ScaleVariation,
		double DimensionVariation,
		double RatioTolerance,
		int Seed,
		ref object Variants,
		ref object Data)
    {
        List<Brep> geometries = new List<Brep>();
        List<string> csv = new List<string>();

        if (Brep == null || Iterations <= 0)
            return;


        // GET BASE GEOMETRY DIMENSIONS
        BoundingBox bbox = Brep.GetBoundingBox(true);

        double L0 = bbox.Max.X - bbox.Min.X;
        double W0 = bbox.Max.Y - bbox.Min.Y;
        double H0 = bbox.Max.Z - bbox.Min.Z;

        if (L0 <= 0 || W0 <= 0 || H0 <= 0)
            return;

        // ORIGINAL PROPORTIONS
        double ratioLW = L0 / W0;
        double ratioLH = L0 / H0;
        double ratioWH = W0 / H0;

        // CREATE LATIN HYPERCUBE SAMPLES
        Random random = new Random(Seed);

        double[] scaleSamples =
            LatinHypercube(Iterations, random);

        double[] lSamples =
            LatinHypercube(Iterations, random);

        double[] wSamples =
            LatinHypercube(Iterations, random);

        double[] hSamples =
            LatinHypercube(Iterations, random);

        // CSV HEADER
        csv.Add(
            "ID,Scale,Length,Width,Height," +
            "SurfaceArea,Volume,L_W,L_H,W_H,RatioError"
        );

        // GENERATE GEOMETRIES
        int generated = 0;

        for (int i = 0; i < Iterations; i++)
        {

            // Overall scale: Example ScaleVariation = 0.05 ---> gives 0.95 -> 1.05
            double scale =
                1.0 +
                (scaleSamples[i] - 0.5)
                * 2.0
                * ScaleVariation;

            // Small dimension perturbations: Example DimensionVariation = 0.02 ---> gives ±2%
            double lFactor =
                1.0 +
                (lSamples[i] - 0.5)
                * 2.0
                * DimensionVariation;

            double wFactor =
                1.0 +
                (wSamples[i] - 0.5)
                * 2.0
                * DimensionVariation;

            double hFactor =
                1.0 +
                (hSamples[i] - 0.5)
                * 2.0
                * DimensionVariation;

            // FINAL DIMENSIONS
            double L = L0 * scale * lFactor;
            double W = W0 * scale * wFactor;
            double H = H0 * scale * hFactor;

            // CURRENT RATIOS
            double currentLW = L / W;
            double currentLH = L / H;
            double currentWH = W / H;

            // RATIO ERRORS
            double errorLW =
                Math.Abs(currentLW - ratioLW)
                / ratioLW;

            double errorLH =
                Math.Abs(currentLH - ratioLH)
                / ratioLH;

            double errorWH =
                Math.Abs(currentWH - ratioWH)
                / ratioWH;


            double ratioError =
                (errorLW + errorLH + errorWH)
                / 3.0;

            // PROPORTION FILTER
            if (ratioError > RatioTolerance)
                continue;


            // CREATE BOX
            Brep box =
                CreateBox(
                    L,
                    W,
                    H,
                    bbox.Min
                );

            geometries.Add(box);


            // GEOMETRIC PROPERTIES
            double area =
                2.0 *
                (
                    L * W +
                    L * H +
                    W * H
                );

            double volume =
                L * W * H;


            // CSV
            string row =
                generated.ToString() + "," +
                scale.ToString("F6") + "," +
                L.ToString("F6") + "," +
                W.ToString("F6") + "," +
                H.ToString("F6") + "," +
                area.ToString("F6") + "," +
                volume.ToString("F6") + "," +
                currentLW.ToString("F6") + "," +
                currentLH.ToString("F6") + "," +
                currentWH.ToString("F6") + "," +
                ratioError.ToString("F6");

            csv.Add(row);

            generated++;
        }


        // 6. OUTPUT
        Variants = geometries;
        Data = csv;
    }


    // LATIN HYPERCUBE SAMPLING ---

    private double[] LatinHypercube(
        int n,
        Random random)
    {
        double[] samples = new double[n];

        // Divide [0,1] into N equal intervals
        for (int i = 0; i < n; i++)
        {
            double lower = (double)i / n;
            double upper = (double)(i + 1) / n;

            samples[i] =
                lower +
                random.NextDouble()
                * (upper - lower);
        }


        // Randomly shuffle samples
        for (int i = n - 1; i > 0; i--)
        {
            int j = random.Next(i + 1);

            double temp = samples[i];
            samples[i] = samples[j];
            samples[j] = temp;
        }

        return samples;
    }


    // CREATE BOX ---
    private Brep CreateBox(
        double L,
        double W,
        double H,
        Point3d origin)
    {
        Point3d p0 = origin;

        Point3d p1 =
            origin +
            new Vector3d(L, 0, 0);

        Point3d p2 =
            origin +
            new Vector3d(L, W, 0);

        BoundingBox box =
            new BoundingBox(
                p0,
                p2 +
                new Vector3d(0, 0, H)
            );

        return Brep.CreateFromBox(box);
    }
}
# ---------- end c_script ----------

# ---- group: GA
c_script_2 = CSharpScript(Iterations=Slider(150, range=100..10000))  # -> Variants, Data; inputs Brep: Brep, Iterations: Int32
# ---------- c_script_2: C# ----------
using System;
using System.Collections.Generic;
using Rhino;
using Rhino.Geometry;

public class Script_Instance : GH_ScriptInstance
{
    private void RunScript(
		Brep Brep,
		int Iterations,
		ref object Variants,
		ref object Data)
    {
        List<Brep> outputGeometry = new List<Brep>();
        List<string> outputData = new List<string>();

        if (Brep == null)
            return;

        if (Iterations <= 0)
            return;

        // 1. GET ORIGINAL GEOMETRY DIMENSIONS
        BoundingBox bbox = Brep.GetBoundingBox(true);

        double L0 = bbox.Max.X - bbox.Min.X;
        double W0 = bbox.Max.Y - bbox.Min.Y;
        double H0 = bbox.Max.Z - bbox.Min.Z;

        if (L0 <= 0 || W0 <= 0 || H0 <= 0)
            return;

        // 2. ORIGINAL PROPORTIONS
        double originalLW = L0 / W0;
        double originalLH = L0 / H0;
        double originalWH = W0 / H0;

        double originalArea =
            2.0 * (L0 * W0 + L0 * H0 + W0 * H0);

        double originalVolume =
            L0 * W0 * H0;

        // 3. GA SETTINGS

        int populationSize = 50;

        // Maximum change from original dimensions
        double variation = 0.05;   // ±5%

        // Mutation probability
        double mutationRate = 0.20;

        // Mutation magnitude
        double mutationStrength = 0.02;

        // Random seed
        Random random = new Random(12345);

        // 4. INITIAL POPULATION
        List<Individual> population =
            new List<Individual>();

        for (int i = 0; i < populationSize; i++)
        {
            double l =
                L0 * (1.0 + RandomRange(random, -variation, variation));

            double w =
                W0 * (1.0 + RandomRange(random, -variation, variation));

            double h =
                H0 * (1.0 + RandomRange(random, -variation, variation));

            population.Add(
                new Individual(l, w, h)
            );
        }

        // 5. EVALUATE INITIAL POPULATION
        EvaluatePopulation(
            population,
            L0,
            W0,
            H0,
            originalLW,
            originalLH,
            originalWH
        );

        // 6. GENETIC ALGORITHM
        int generated = 0;

        while (generated < Iterations)
        {
            // Sort population by fitness
            population.Sort(
                delegate(Individual a, Individual b)
                {
                    return b.Fitness.CompareTo(a.Fitness);
                }
            );

            // Output best individual
            Individual best = population[0];

            Brep box = CreateBox(
                best.L,
                best.W,
                best.H,
                bbox.Min
            );

            outputGeometry.Add(box);

            // Calculate derived parameters
            double area =
                2.0 * (
                    best.L * best.W +
                    best.L * best.H +
                    best.W * best.H
                );

            double volume =
                best.L * best.W * best.H;

            double lw =
                best.L / best.W;

            double lh =
                best.L / best.H;

            double wh =
                best.W / best.H;


            // Store dataset information
            string row =
                generated.ToString() + "," +
                best.L.ToString("F6") + "," +
                best.W.ToString("F6") + "," +
                best.H.ToString("F6") + "," +
                area.ToString("F6") + "," +
                volume.ToString("F6") + "," +
                lw.ToString("F6") + "," +
                lh.ToString("F6") + "," +
                wh.ToString("F6") + "," +
                best.Fitness.ToString("F6");

            outputData.Add(row);

            generated++;


            // Stop if requested number has been reached
            if (generated >= Iterations)
                break;

            // Create new generation
            List<Individual> newPopulation =
                new List<Individual>();

            // Elitism : Keep best 2 individuals
            newPopulation.Add(
                population[0].Clone()
            );

            if (populationSize > 1)
            {
                newPopulation.Add(
                    population[1].Clone()
                );
            }


            // Fill remaining population
            while (newPopulation.Count < populationSize)
            {
                // Tournament selection
                Individual parent1 =
                    TournamentSelection(
                        population,
                        random
                    );

                Individual parent2 =
                    TournamentSelection(
                        population,
                        random
                    );


                // Crossover
                Individual child =
                    Crossover(
                        parent1,
                        parent2,
                        random
                    );


                // Mutation
                Mutate(
                    child,
                    L0,
                    W0,
                    H0,
                    mutationRate,
                    mutationStrength,
                    variation,
                    random
                );


                newPopulation.Add(child);
            }


            population = newPopulation;


            // Evaluate new generation
            EvaluatePopulation(
                population,
                L0,
                W0,
                H0,
                originalLW,
                originalLH,
                originalWH
            );
        }

        // OUTPUT
        Variants = outputGeometry;


        List<string> csv =
            new List<string>();

        csv.Add(
            "ID,Length,Width,Height,SurfaceArea,Volume,L_W,L_H,W_H,Fitness"
        );

        csv.AddRange(outputData);

        Data = csv;
    }

    

   // Individual ---
    class Individual
    {
        public double L;
        public double W;
        public double H;

        public double Fitness;

        public Individual(double l, double w, double h)
        {
            L = l;
            W = w;
            H = h;
        }

        public Individual Clone()
        {
            return new Individual(L, W, H);
        }
    }

   // FITNESS ---
    private void EvaluatePopulation(
        List<Individual> population,
        double L0,
        double W0,
        double H0,
        double originalLW,
        double originalLH,
        double originalWH)
    {
        foreach (Individual ind in population)
        {
            double currentLW =
                ind.L / ind.W;

            double currentLH =
                ind.L / ind.H;

            double currentWH =
                ind.W / ind.H;


            // Proportion differences
            double errorLW =
                Math.Abs(currentLW - originalLW)
                / originalLW;

            double errorLH =
                Math.Abs(currentLH - originalLH)
                / originalLH;

            double errorWH =
                Math.Abs(currentWH - originalWH)
                / originalWH;


            // Dimension difference
            double errorL =
                Math.Abs(ind.L - L0) / L0;

            double errorW =
                Math.Abs(ind.W - W0) / W0;

            double errorH =
                Math.Abs(ind.H - H0) / H0;


            // Total error - Higher weight on proportions
            double proportionError =
                (errorLW + errorLH + errorWH) / 3.0;

            double dimensionError =
                (errorL + errorW + errorH) / 3.0;


            double totalError =
                proportionError * 0.70 +
                dimensionError * 0.30;


            // Fitness: 
            // 1.0 = identical to original
            // Lower values = more different
            ind.Fitness =
                1.0 / (1.0 + totalError);
        }
    }

   // TOURNAMENT SELECTION ---
    private Individual TournamentSelection(
        List<Individual> population,
        Random random)
    {
        int tournamentSize = 3;

        Individual best = null;

        for (int i = 0; i < tournamentSize; i++)
        {
            int index =
                random.Next(population.Count);

            Individual candidate =
                population[index];

            if (best == null ||
                candidate.Fitness > best.Fitness)
            {
                best = candidate;
            }
        }

        return best;
    }

   // CROSSOVER ---
    private Individual Crossover(
        Individual a,
        Individual b,
        Random random)
    {
        double tL = random.NextDouble();
        double tW = random.NextDouble();
        double tH = random.NextDouble();

        double L =
            a.L * tL +
            b.L * (1.0 - tL);

        double W =
            a.W * tW +
            b.W * (1.0 - tW);

        double H =
            a.H * tH +
            b.H * (1.0 - tH);

        return new Individual(L, W, H);
    }

   // MUTATION ---
    private void Mutate(
        Individual ind,
        double L0,
        double W0,
        double H0,
        double mutationRate,
        double mutationStrength,
        double variation,
        Random random)
    {
        // Length
        if (random.NextDouble() < mutationRate)
        {
            ind.L *=
                1.0 +
                RandomRange(
                    random,
                    -mutationStrength,
                    mutationStrength
                );
        }


        // Width
        if (random.NextDouble() < mutationRate)
        {
            ind.W *=
                1.0 +
                RandomRange(
                    random,
                    -mutationStrength,
                    mutationStrength
                );
        }


        // Height
        if (random.NextDouble() < mutationRate)
        {
            ind.H *=
                1.0 +
                RandomRange(
                    random,
                    -mutationStrength,
                    mutationStrength
                );
        }

        // Keep geometry within allowed variation
        ind.L =
            Clamp(
                ind.L,
                L0 * (1.0 - variation),
                L0 * (1.0 + variation)
            );

        ind.W =
            Clamp(
                ind.W,
                W0 * (1.0 - variation),
                W0 * (1.0 + variation)
            );

        ind.H =
            Clamp(
                ind.H,
                H0 * (1.0 - variation),
                H0 * (1.0 + variation)
            );
    }

   // CREATE BOX ---
    private Brep CreateBox(
        double L,
        double W,
        double H,
        Point3d origin)
    {
        Point3d p0 = origin;
        Point3d p1 = origin + new Vector3d(L, 0, 0);
        Point3d p2 = origin + new Vector3d(L, W, 0);

        BoundingBox box =
            new BoundingBox(
                p0,
                p2 + new Vector3d(0, 0, H)
            );

        Brep boxBrep = Brep.CreateFromBox(box);

        return boxBrep;
    }

   // RANDOM RANGE ---
    private double RandomRange(
        Random random,
        double min,
        double max)
    {
        return min +
               random.NextDouble() *
               (max - min);
    }

   // CLAMP ---
    private double Clamp(
        double value,
        double min,
        double max)
    {
        return Math.Max(
            min,
            Math.Min(max, value)
        );
    }

}
# ---------- end c_script_2 ----------

# ----
panel = Panel(c_script.Variants)
panel_2 = Panel(c_script.Data)

# ---- group: Raytrace
c_script_3 = CSharpScript(
    brep=brep,
    originPt=point,
    rayLength=Slider(16, range=0..1000),
    rayCount=Slider(18, range=0..100),
    maxBounces=Slider(5, range=0..10))  # -> Rays; inputs brep: Brep, originPt: Point3d, rayLength: Double, rayCount: Int32, maxBounces: Int32
# ---------- c_script_3: C# ----------
using Rhino;
using Rhino.Geometry;
using Rhino.Geometry.Intersect;
using System;
using System.Collections.Generic;

public class Script_Instance : GH_ScriptInstance
{
    private void RunScript(
		Brep brep,
		Point3d originPt,
		double rayLength,
		int rayCount,
		int maxBounces,
		ref object Rays)
    {
       if (brep == null)
            return;

        rayCount = Math.Max(rayCount, 1);
        maxBounces = Math.Max(maxBounces, 1);
        rayLength = Math.Max(rayLength, 0.001);

        List<Line> rays = new List<Line>();


        // Generate initial ray directions
        for (int i = 0; i < rayCount; i++)
        {
            // Fibonacci sphere distribution
            double phi =
                Math.Acos(
                    1.0 -
                    2.0 * (i + 0.5) / rayCount
                );

            double theta =
                Math.PI *
                (1.0 + Math.Sqrt(5.0)) *
                i;

            Vector3d direction =
                new Vector3d(
                    Math.Sin(phi) * Math.Cos(theta),
                    Math.Sin(phi) * Math.Sin(theta),
                    Math.Cos(phi)
                );

            direction.Unitize();

            // Trace ray
            TraceRay(
                brep,
                originPt,
                direction,
                rayLength,
                maxBounces,
                rays
            );
        }

        Rays = rays;
    }

    // TRACE ONE RAY ---
    private void TraceRay(
        Brep brep,
        Point3d start,
        Vector3d direction,
        double rayLength,
        int maxBounces,
        List<Line> rays)
    {
        Point3d currentOrigin = start;
        Vector3d currentDirection = direction;

        // Small offset to prevent self-intersection
        double offset = 0.001;


        for (int bounce = 0;
             bounce < maxBounces;
             bounce++)
        {
            // Create finite ray
            Point3d endPoint =
                currentOrigin +
                currentDirection * rayLength;

            LineCurve rayCurve =
                new LineCurve(
                    currentOrigin,
                    endPoint
                );

            // Brep intersection
            Curve[] overlapCurves;
            Point3d[] intersectionPoints;
            double[] curveParameters;

            bool success =
                Intersection.CurveBrep(
                    rayCurve,
                    brep,
                    RhinoDoc.ActiveDoc.ModelAbsoluteTolerance,
                    out overlapCurves,
                    out intersectionPoints,
                    out curveParameters
                );


            // No intersection
            if (!success ||
                intersectionPoints == null ||
                intersectionPoints.Length == 0)
            {
                break;
            }


            // Find nearest intersection
            double nearestDistance =
                double.MaxValue;

            Point3d nearestPoint =
                Point3d.Unset;


            foreach (Point3d point in intersectionPoints)
            {
                double distance =
                    currentOrigin.DistanceTo(point);

                // Ignore self-intersection
                if (distance <= offset)
                    continue;

                if (distance < nearestDistance)
                {
                    nearestDistance = distance;
                    nearestPoint = point;
                }
            }


            // No valid intersection
            if (!nearestPoint.IsValid)
                break;

            // Store ray segment
            rays.Add(
                new Line(
                    currentOrigin,
                    nearestPoint
                )
            );

            // Find the Brep face at the hit point
            BrepFace face =
                FindClosestFace(
                    brep,
                    nearestPoint
                );

            if (face == null)
                break;

            // Find UV coordinates
            double u;
            double v;

            if (!face.ClosestPoint(
                nearestPoint,
                out u,
                out v))
            {
                break;
            }

            // Surface normal
            Vector3d normal =
                face.NormalAt(u, v);

            normal.Unitize();

            // Reflection R = D - 2(D·N)N
            double dot =
                currentDirection * normal;

            Vector3d reflectedDirection =
                currentDirection -
                2.0 * dot * normal;

            reflectedDirection.Unitize();

            // Move slightly away from surface
            currentOrigin =
                nearestPoint +
                reflectedDirection * offset;

            currentDirection =
                reflectedDirection;
        }
    }

    // FIND CLOSEST BREP FACE---

    private BrepFace FindClosestFace(
        Brep brep,
        Point3d point)
    {
        double minimumDistance =
            double.MaxValue;

        BrepFace closestFace = null;


        foreach (BrepFace face in brep.Faces)
        {
            double u;
            double v;

            if (!face.ClosestPoint(
                point,
                out u,
                out v))
            {
                continue;
            }


            Point3d closestPoint =
                face.PointAt(u, v);

            double distance =
                point.DistanceTo(
                    closestPoint
                );


            if (distance < minimumDistance)
            {
                minimumDistance = distance;
                closestFace = face;
            }
        }


        return closestFace;
    }
}
# ---------- end c_script_3 ----------

# ----
line = Line(c_script_3)
panel_3 = Panel(line)
c_script_4 = CSharpScript(
    Breps=c_script.Variants,
    originPt=point,
    rayLength=Slider(16, range=0..1000),
    rayCount=Slider(18, range=0..100),
    maxBounces=Slider(5, range=0..10))  # -> out, Rays, CSV; inputs Breps: list of Brep, originPt: Point3d, rayLength: Double, rayCount: Int32, maxBounces: Int32
# ---------- c_script_4: C# ----------
using Rhino;
using Rhino.Geometry;
using Rhino.Geometry.Intersect;
using System;
using System.Collections.Generic;
using System.Text;

public class Script_Instance : GH_ScriptInstance
{
    private void RunScript(
		List<Brep> Breps,
		Point3d originPt,
		double rayLength,
		int rayCount,
		int maxBounces,
		ref object Rays,
		ref object CSV)
    {
        if (Breps == null || Breps.Count == 0)
            return;

        rayCount = Math.Max(rayCount, 1);
        maxBounces = Math.Max(maxBounces, 1);
        rayLength = Math.Max(rayLength, 0.001);

        // Store all ray segments from all geometries
        List<Line> allRays = new List<Line>();

        // CSV data
        StringBuilder csv = new StringBuilder();

        // CSV header
        csv.AppendLine(
            "GeometryID,RayID,BounceID," +
            "StartX,StartY,StartZ," +
            "EndX,EndY,EndZ," +
            "DirectionX,DirectionY,DirectionZ," +
            "MidpointX,MidpointY,MidpointZ," +
            "Length"
        );

        // Global RayID
        int globalRayID = 0;

        // LOOP THROUGH EVERY LHS BREP
        for (int geometryIndex = 0;
             geometryIndex < Breps.Count;
             geometryIndex++)
        {
            Brep brep = Breps[geometryIndex];

            if (brep == null)
                continue;

            // GeometryID starts at 1
            int geometryID = geometryIndex + 1;

            // GENERATE RAYS FOR THIS GEOMETRY
            for (int i = 0; i < rayCount; i++)
            {
                // Each original ray gets a unique ID
                globalRayID++;

                // Fibonacci sphere distribution
                double phi =
                    Math.Acos(
                        1.0 -
                        2.0 * (i + 0.5) / rayCount
                    );

                double theta =
                    Math.PI *
                    (1.0 + Math.Sqrt(5.0)) *
                    i;

                Vector3d direction =
                    new Vector3d(
                        Math.Sin(phi) * Math.Cos(theta),
                        Math.Sin(phi) * Math.Sin(theta),
                        Math.Cos(phi)
                    );

                direction.Unitize();

                // Trace ray
                TraceRay(
                    brep,
                    originPt,
                    direction,
                    rayLength,
                    maxBounces,
                    geometryID,
                    globalRayID,
                    allRays,
                    csv
                );
            }
        }

        // Output all ray segments
        Rays = allRays;

        // Output CSV as one text object
        CSV = csv.ToString();
    }

    // TRACE ONE RAY
    private void TraceRay(
        Brep brep,
        Point3d start,
        Vector3d direction,
        double rayLength,
        int maxBounces,
        int geometryID,
        int rayID,
        List<Line> rays,
        StringBuilder csv)
    {
        Point3d currentOrigin = start;
        Vector3d currentDirection = direction;

        // Small offset to prevent self-intersection
        double offset = 0.001;

        for (int bounce = 0;
             bounce < maxBounces;
             bounce++)
        {
            // Create finite ray
            Point3d endPoint =
                currentOrigin +
                currentDirection * rayLength;

            LineCurve rayCurve =
                new LineCurve(
                    currentOrigin,
                    endPoint
                );

            // BREP INTERSECTION
            Curve[] overlapCurves;
            Point3d[] intersectionPoints;
            double[] curveParameters;

            bool success =
                Intersection.CurveBrep(
                    rayCurve,
                    brep,
                    RhinoDoc.ActiveDoc.ModelAbsoluteTolerance,
                    out overlapCurves,
                    out intersectionPoints,
                    out curveParameters
                );


            // No intersection
            if (!success ||
                intersectionPoints == null ||
                intersectionPoints.Length == 0)
            {
                break;
            }

            // FIND NEAREST INTERSECTION
            double nearestDistance =
                double.MaxValue;

            Point3d nearestPoint =
                Point3d.Unset;


            foreach (Point3d point in intersectionPoints)
            {
                double distance =
                    currentOrigin.DistanceTo(point);

                // Ignore self-intersection
                if (distance <= offset)
                    continue;

                if (distance < nearestDistance)
                {
                    nearestDistance = distance;
                    nearestPoint = point;
                }
            }


            // No valid intersection
            if (!nearestPoint.IsValid)
                break;

            // STORE RAY SEGMENT
            Line raySegment =
                new Line(
                    currentOrigin,
                    nearestPoint
                );

            rays.Add(raySegment);

            // CALCULATE RAY INFORMATION FOR CSV
            Vector3d segmentDirection =
                nearestPoint - currentOrigin;

            double segmentLength =
                segmentDirection.Length;

            if (segmentLength > 0)
                segmentDirection.Unitize();


            Point3d midpoint =
                new Point3d(
                    (currentOrigin.X + nearestPoint.X) / 2.0,
                    (currentOrigin.Y + nearestPoint.Y) / 2.0,
                    (currentOrigin.Z + nearestPoint.Z) / 2.0
                );


            // CSV ROW
            csv.AppendLine(
                geometryID + "," +
                rayID + "," +
                bounce + "," +

                currentOrigin.X.ToString("G17") + "," +
                currentOrigin.Y.ToString("G17") + "," +
                currentOrigin.Z.ToString("G17") + "," +

                nearestPoint.X.ToString("G17") + "," +
                nearestPoint.Y.ToString("G17") + "," +
                nearestPoint.Z.ToString("G17") + "," +

                segmentDirection.X.ToString("G17") + "," +
                segmentDirection.Y.ToString("G17") + "," +
                segmentDirection.Z.ToString("G17") + "," +

                midpoint.X.ToString("G17") + "," +
                midpoint.Y.ToString("G17") + "," +
                midpoint.Z.ToString("G17") + "," +

                segmentLength.ToString("G17")
            );

            // FIND BREP FACE AT HIT POINT
            BrepFace face =
                FindClosestFace(
                    brep,
                    nearestPoint
                );

            if (face == null)
                break;

            // FIND UV COORDINATES
            double u;
            double v;

            if (!face.ClosestPoint(
                nearestPoint,
                out u,
                out v))
            {
                break;
            }

            // SURFACE NORMAL
            Vector3d normal =
                face.NormalAt(u, v);

            normal.Unitize();

            // REFLECTION: R = D - 2(D·N)N
            double dot =
                currentDirection * normal;

            Vector3d reflectedDirection =
                currentDirection -
                2.0 * dot * normal;

            reflectedDirection.Unitize();

            // MOVE AWAY FROM SURFACE
            currentOrigin =
                nearestPoint +
                reflectedDirection * offset;

            currentDirection =
                reflectedDirection;
        }
    }

    // FIND CLOSEST BREP FACE ---
    private BrepFace FindClosestFace(
        Brep brep,
        Point3d point)
    {
        double minimumDistance =
            double.MaxValue;

        BrepFace closestFace = null;


        foreach (BrepFace face in brep.Faces)
        {
            double u;
            double v;

            if (!face.ClosestPoint(
                point,
                out u,
                out v))
            {
                continue;
            }


            Point3d closestPoint =
                face.PointAt(u, v);


            double distance =
                point.DistanceTo(
                    closestPoint
                );


            if (distance < minimumDistance)
            {
                minimumDistance = distance;
                closestFace = face;
            }
        }

        return closestFace;
    }
}
# ---------- end c_script_4 ----------

# ---- group: CSV Converter
c_script_5 = CSharpScript(Rays=line)  # -> CSV, Data; inputs Rays: list of Line
# ---------- c_script_5: C# ----------
using System;
using System.Collections.Generic;
using System.Globalization;
using Rhino.Geometry;

public class Script_Instance : GH_ScriptInstance
{
    private void RunScript(List<Line> Rays, ref object CSV, ref object Data)
    {
         if (Rays == null || Rays.Count == 0)
            return;

        List<string> csv = new List<string>();
        List<string> data = new List<string>();

        // CSV HEADER
        csv.Add(
            "SegmentID," +
            "OriginX,OriginY,OriginZ," +
            "HitX,HitY,HitZ," +
            "MidX,MidY,MidZ," +
            "Length," +
            "DirX,DirY,DirZ," +
            "Azimuth," +
            "Elevation"
        );

        // UNIQUE SEGMENT ID
        int segmentID = 0;

        // PROCESS EACH LINE
        foreach (Line ray in Rays)
        {
            if (!ray.IsValid)
                continue;

            // ORIGIN
            Point3d origin = ray.From;

            // HIT / END POINT
            Point3d hit = ray.To;

            // MIDPOINT
            Point3d midpoint =
                ray.PointAt(0.5);

            // LENGTH
            double length =
                ray.Length;

            // DIRECTION
            Vector3d direction =
                hit - origin;

            if (!direction.Unitize())
                continue;

            // AZIMUTH
            double azimuth =
                Math.Atan2(
                    direction.Y,
                    direction.X
                )
                * 180.0 / Math.PI;

            if (azimuth < 0)
                azimuth += 360.0;

            // ELEVATION
            double horizontalLength =
                Math.Sqrt(
                    direction.X * direction.X +
                    direction.Y * direction.Y
                );

            double elevation =
                Math.Atan2(
                    direction.Z,
                    horizontalLength
                )
                * 180.0 / Math.PI;

            // CSV ROW
            string row =
                segmentID + "," +

                F(origin.X) + "," +
                F(origin.Y) + "," +
                F(origin.Z) + "," +

                F(hit.X) + "," +
                F(hit.Y) + "," +
                F(hit.Z) + "," +

                F(midpoint.X) + "," +
                F(midpoint.Y) + "," +
                F(midpoint.Z) + "," +

                F(length) + "," +

                F(direction.X) + "," +
                F(direction.Y) + "," +
                F(direction.Z) + "," +

                F(azimuth) + "," +
                F(elevation);


            csv.Add(row);

            data.Add(row);

            segmentID++;
        }

        // OUTPUT
        CSV = csv;
        Data = data;
    }

    // NUMBER FORMAT ---
    private string F(double value)
    {
        return value.ToString(
            "F6",
            CultureInfo.InvariantCulture
        );
    }
}
# ---------- end c_script_5 ----------

# ----
panel_4 = Panel(c_script_5.CSV)
panel_5 = Panel(c_script_4.CSV)
